# Grasshopper definition AnalyseBrep_1 (1).gh (Grasshopper 1.0.7)
# plug-ins: SolidsVR, MDSKGrasshopper

pt = Point([<point referenced from the Rhino model> x8])
# PREDEF
sphere = Brep(<brep referenced from the Rhino model>)
predef_slider = Curve(<curve referenced from the Rhino model>)
# LOAD AND BC
bc_surf = Curve(<curve referenced from the Rhino model>)
load_value = Curve(<curve referenced from the Rhino model>)
load_surf = Curve(<curve referenced from the Rhino model>)
# MESHING
_3_mesh_curves = Curve([<curve referenced from the Rhino model> x3])
# BREP
p2b = PointsToBrep(Points=pt)
surfslider = SurfaceSlider(SliderVR=load_surf, Brep=p2b)  # -> Surface, Text, Size, Plane, Colors, Geometry
surfslider_2 = SurfaceSlider(SliderVR=bc_surf, Brep=p2b)  # -> Surface, Text, Size, Plane, Colors, Geometry
divslider = DivisionSlider(SliderVR=_3_mesh_curves, Brep=p2b)  # -> MeshDivisionU, MeshDivisionV, MeshDivisionW, Text, Size, Plane, Colors, Geometry

number_slider = Slider(1000, range=0..1000)  # disabled
pt_2 = ConstructPoint(XCoordinate=number_slider, YCoordinate=number_slider, ZCoordinate=number_slider)  # disabled
pt_3 = ConstructPoint(XCoordinate=0, YCoordinate=number_slider, ZCoordinate=number_slider)  # disabled
pt_4 = ConstructPoint(XCoordinate=number_slider, YCoordinate=0, ZCoordinate=number_slider)  # disabled
# TESTING
pt_5 = ConstructPoint(XCoordinate=number_slider, YCoordinate=number_slider, ZCoordinate=0)  # disabled
pt_6 = ConstructPoint(XCoordinate=0, YCoordinate=number_slider, ZCoordinate=0)  # disabled
pt_7 = ConstructPoint(XCoordinate=0, YCoordinate=0, ZCoordinate=number_slider)  # disabled
ln = Line(StartPoint=pt_2, EndPoint=pt_3)  # disabled
panel = Panel("0,0,0")  # disabled
number_slider_2 = Slider(5, range=0..10)  # disabled
pt_8 = ConstructPoint(XCoordinate=0, YCoordinate=0, ZCoordinate=0)  # disabled
pt_9 = ConstructPoint(XCoordinate=number_slider, YCoordinate=0, ZCoordinate=0)  # disabled
number_slider_3 = Slider(1, range=0..9)  # disabled
panel_2 = Panel("-10")  # disabled
p2b_2 = PointsToBrep(Points=[pt_8, pt_9, pt_5, pt_6, pt_7, pt_4, pt_2, pt_3])  # disabled
debrep = DeconstructBrep(Brep=p2b_2)  # -> Faces, Edges, Vertices; disabled
number_slider_4 = Slider(4, range=0..10)  # disabled
item = ListItem(List=debrep.Faces, Index=number_slider_2, Wrap=True)  # disabled
predefslider = PreDefSlider(SliderVR=ln, Brep=p2b_2)  # -> Load, Text, Size, Plane, Colors, Geometry; disabled
item_2 = ListItem(List=debrep.Faces, Index=number_slider_4, Wrap=True)  # disabled
panel_3 = Panel("0.3")  # disabled
Z = UnitZ(Factor=panel_2)  # disabled
predef = PreDef(Points=pt_8, PrescribedDeformations=predefslider.Load)  # disabled
panel_4 = Panel("210000")  # disabled
meshtbrep = MeshTBrep(Brep=p2b_2, UCount=number_slider_3, VCount=number_slider_3, WCount=number_slider_3)  # disabled
unibc = UniformBCComponentForFEA(Surface=item_2, UCount=number_slider_3, VCount=number_slider_3, WCount=number_slider_3, Brep=p2b_2)  # -> BCPoints, BCCones, ColoringForBCCones; disabled
uniloads = UniformLoadComponentForFEA(Surface=item, LoadVector=Z, UCount=number_slider_3, VCount=number_slider_3, WCount=number_slider_3, Brep=p2b_2)  # -> PointLoads, LoadArrows, ArrowColoring; disabled
material = CreateMaterial(EModulus=panel_4, PRatio=panel_3)  # disabled
femeshtbrep = FiniteElementOfMeshedTBrep(
    Mesh=meshtbrep,
    BoundaryConditions=unibc.BCPoints,
    PointLoads=uniloads.PointLoads,
    PreDeformations=predef,
    Brep=p2b_2,
    Material=material)  # -> Displacement, Strain, Stress, Nodes, Text, Size, Plane, ColorT; disabled
panel_5 = Panel(femeshtbrep.Displacement)  # disabled

loadslider = LoadSlider(SliderVR=load_value, Brep=p2b)  # -> Load, Text, Size, Plane, Colors, Geometry
# MODEL TOGGLE
model_toggle = BooleanToggle(False)
mdsk_geometry = MDSK(Geometry=p2b, Color=RGB(255, 255, 255), Start=model_toggle)
mdsk_geometry_2 = MDSK(Geometry=surfslider.Geometry, Color=surfslider.Colors, Start=model_toggle)
mdsk_geometry_3 = MDSK(Geometry=divslider.Geometry, Color=divslider.Colors, Start=model_toggle)
mdsk_geometry_4 = MDSK(Geometry=surfslider_2.Geometry, Color=surfslider_2.Colors, Start=model_toggle)
predefslider_2 = PreDefSlider(SliderVR=predef_slider, Brep=p2b)  # -> PrescribedDeformation, Text, Size, Plane, Colors, Geometry
unibc_2 = UniformBCComponentForFEA(
    Surface=surfslider_2.Surface,
    UCount=divslider.MeshDivisionU,
    VCount=divslider.MeshDivisionV,
    WCount=divslider.MeshDivisionW,
    Brep=p2b)  # -> BCPoints, BCCones, ColoringForBCCones
uniloads_2 = UniformLoadComponentForFEA(
    Surface=surfslider.Surface,
    LoadVector=loadslider.Load,
    UCount=divslider.MeshDivisionU,
    VCount=divslider.MeshDivisionV,
    WCount=divslider.MeshDivisionW,
    Brep=p2b)  # -> PointLoads, LoadArrows, ArrowColoring
mdsk_geometry_5 = MDSK(Geometry=loadslider.Geometry, Color=loadslider.Colors, Start=model_toggle)
mdsk_geometry_6 = MDSK(Geometry=uniloads_2.LoadArrows, Color=uniloads_2.ArrowColoring, Start=model_toggle)
mdsk_geometry_7 = MDSK(Geometry=unibc_2.BCCones, Color=unibc_2.ColoringForBCCones, Start=model_toggle)
pt_10 = ConstructPoint(XCoordinate="999", YCoordinate="999", ZCoordinate="999")
predef_2 = PreDef(Points=pt_10, PrescribedDeformations=predefslider_2.PrescribedDeformation)
# ANALYSE TOGGLE
preview_toggle = BooleanToggle(False)
meshcbrep = MeshCBrep(Brep=p2b, Point=pt, UCount=divslider.MeshDivisionU, VCount=divslider.MeshDivisionV, WCount=divslider.MeshDivisionW)
closest_point = FindTheClosestPointToSphere(Sphere=sphere, Mesh=meshcbrep, Brep=p2b)  # -> Point, Text, Plane, Colors
panel_6 = Panel(closest_point.Point)
panel_7 = Panel(predef_2)
deconstruct_meshcbrep = DeconstructMesh(Mesh=meshcbrep)  # -> ElementVertices, Connectivity, Edges, Surfaces, Nodes
panel_8 = Panel(deconstruct_meshcbrep.Surfaces)
material_2 = CreateMaterial(EModulus="210000", PRatio="0.3")
crv = Curve(deconstruct_meshcbrep.Edges)
# ANALYSE
femeshtbrep_2 = FiniteElementOfMeshedTBrep(
    Mesh=meshcbrep,
    BoundaryConditions=unibc_2.BCPoints,
    PointLoads=uniloads_2.PointLoads,
    PreDeformations=predef_2,
    Brep=p2b,
    Material=material_2)  # -> Displacement, Strain, Stress, Nodes, Text, Size, Plane, ColorT
item_3 = ListItem(List=deconstruct_meshcbrep.Surfaces, Index=Slider(32, range=0..100), Wrap=True)
srf = Surface(item_3)
scale_def_curve = Curve(<curve referenced from the Rhino model>)
stress_direction = Curve(<curve referenced from the Rhino model>)
defslider = DeformationSlider(SliderVR=scale_def_curve, Brep=p2b)  # -> Scale, Text, Size, Plane, Colors, Geometry
stressslider = StressDirectionSlider(SliderVR=stress_direction, Brep=p2b)  # -> StressDirection, Text, Size, Plane, Color, Geometry
panel_9 = Panel(stressslider.Size)
# DEFORMATION PREVIEW
viewdef = ViewDeformations(Mesh=meshcbrep, Displacement=femeshtbrep_2.Displacement, Scaling=defslider.Scale, Brep=p2b)  # -> BrepSolid, ColorSolid, BrepOuterEdges, ColorEdges, Text, Size, Plane, ColorT
mdsk_geometry_8 = MDSK(Geometry=defslider.Geometry, Color=defslider.Colors, Start=preview_toggle)
panel_10 = Panel(stressslider.Text)
# STRESS PREVIEW
viewstress = ViewStresses(
    Mesh=meshcbrep,
    Stresses=femeshtbrep_2.Stress,
    StressDirection=stressslider.StressDirection,
    Displacement=femeshtbrep_2.Displacement,
    Scaling=defslider.Scale,
    Brep=p2b)  # -> Solid, Color_solid, Legend, Color_legend, Text, Size, Plane, Color_T
mdsk_geometry_9 = MDSK(Geometry=stressslider.Geometry, Color=stressslider.Color, Start=preview_toggle)
panel_11 = Panel(defslider.Size)
crv_2 = Curve(viewdef.BrepOuterEdges)
brep = Brep(viewdef.BrepSolid)
mdsk_geometry_10 = MDSK(Geometry=viewdef.BrepSolid, Color=viewdef.ColorSolid, Start=preview_toggle)
mdsk_geometry_11 = MDSK(Geometry=viewdef.BrepOuterEdges, Color=viewdef.ColorEdges, Start=preview_toggle)
mdsk_geometry_12 = MDSK(Geometry=viewstress.Solid, Color=viewstress.Color_solid, Start=preview_toggle)
mdsk_geometry_13 = MDSK(Geometry=viewstress.Legend, Color=viewstress.Color_legend, Start=preview_toggle)
brep_2 = Brep(viewstress.Solid)
brep_3 = Brep(viewstress.Legend)
brep_4 = Brep(viewstress.Legend)
