# Grasshopper definition CantileverTest.gh (Grasshopper 1.0.7)
# plug-ins: SolidsVR

pt = ConstructPoint(XCoordinate=0, YCoordinate="1000", ZCoordinate="1000")
pt_2 = ConstructPoint(XCoordinate=0, YCoordinate=0, ZCoordinate=0)
pt_3 = ConstructPoint(XCoordinate=0, YCoordinate="1000", ZCoordinate=0)
pt_4 = ConstructPoint(XCoordinate=0, YCoordinate=0, ZCoordinate="1000")
pt_5 = ConstructPoint(XCoordinate="1000", YCoordinate=0, ZCoordinate=0)
pt_6 = ConstructPoint(XCoordinate="1000", YCoordinate="1000", ZCoordinate=0)
pt_7 = ConstructPoint(XCoordinate="1000", YCoordinate="1000", ZCoordinate="1000")
pt_8 = ConstructPoint(XCoordinate="1000", YCoordinate=0, ZCoordinate="1000")
number_slider = Slider(5, range=0..5)
number_slider_2 = Slider(3, range=0..5)
Z = UnitZ(Factor="-10")
pt_9 = Point([pt_2, pt_5, pt_6, pt_3, pt_4, pt_8, pt_7, pt])
p2b = PointsToBrep(Points=pt_9)
debrep = DeconstructBrep(Brep=p2b)  # -> Faces, Edges, Vertices
vec = VectorXYZ(XComponent=0, YComponent=0, ZComponent=Slider(0, range=0..100))  # -> Vector, Length
number_slider_3 = Slider(3, range=0..20)
item = ListItem(List=debrep.Faces, Index=number_slider, Wrap=True)
item_2 = ListItem(List=debrep.Faces, Index=number_slider_2, Wrap=True)
sph = Sphere(Base="10000,0,0", Radius="1")
number_slider_4 = Slider(84, range=0..1000)
material = CreateMaterial(EModulus="210000", PRatio="0.3", YieldStress="355")
meshcbrep = MeshCBrep(Brep=p2b, Point=pt_9, UCount=number_slider_3, VCount=number_slider_3, WCount=number_slider_3, RunTopOpt=False)  # disabled
meshsbrep = MeshSBrep(Brep=p2b, Point=pt_9, UCount=number_slider_3, VCount=number_slider_3, WCount=number_slider_3, RunTopOpt=False)  # -> Mesh, Curve, Surface, Curve_2, Surfaces
uniloads = UniformLoadComponentForFEA(SurfaceNumber=number_slider, LoadVector=Z, Mesh=meshsbrep.Mesh)  # -> PointLoads, LoadArrows, ArrowColoring
unibc = UniformBCComponentForFEA(Surface=number_slider_2, UCount=meshsbrep.Mesh)  # -> BCPoints, BCCones, ColoringForBCCones
predef = PreDef(Sphere=sph, PrescribedDeformations=vec.Vector, Mesh=meshsbrep.Mesh)  # -> PrescribedDeformations, Text, Plane, Colors
femeshtbrep = FiniteElementOfMeshedTBrep(
    Mesh=meshcbrep,
    BoundaryConditions=unibc.BCPoints,
    PointLoads=uniloads.PointLoads,
    PreDeformations=predef.PrescribedDeformations,
    Material=material)  # -> Disp, Strain, Stress, N, Text, Size, Plane, Color_T, Nodes; disabled
femeshtbrep_2 = FiniteElementOfMeshedTBrep(
    Mesh=meshsbrep.Mesh,
    BoundaryConditions=unibc.BCPoints,
    PointLoads=uniloads.PointLoads,
    PreDeformations=predef.PrescribedDeformations,
    Material=material)  # -> Disp, Strain, Stress, N, Text, Size, Plane, Color_T, Nodes
viewdef = ViewDeformations(Mesh=meshcbrep, Displacement=femeshtbrep.Disp, Scaling=1)  # -> BrepSolid, ColorSolid, BrepOuterEdges, ColorEdges, Text, Size, Plane, ColorT
panel = Panel(femeshtbrep_2.Disp)
panel_2 = Panel(femeshtbrep.Disp)
