# Grasshopper definition ArchComparing.gh (Grasshopper 1.0.7)
# plug-ins: SolidsVR, Kangaroo2 Components

pt = ConstructPoint(XCoordinate=Slider(-50, range=-50..50), YCoordinate=Slider(-50, range=-50..50), ZCoordinate=0)
pt_2 = ConstructPoint(XCoordinate=Slider(50, range=-50..50), YCoordinate=Slider(-50, range=-50..50), ZCoordinate=0)
pt_3 = ConstructPoint(XCoordinate=Slider(50, range=-50..50), YCoordinate=Slider(50, range=-50..50), ZCoordinate=0)
pt_4 = ConstructPoint(XCoordinate=Slider(-50, range=-50..50), YCoordinate=Slider(50, range=-50..50), ZCoordinate=0)
pt_5 = ConstructPoint(XCoordinate=Slider(1050, range=950..1050), YCoordinate=Slider(-50, range=-50..50), ZCoordinate=0)
pt_6 = ConstructPoint(XCoordinate=0, YCoordinate=0, ZCoordinate=0)
pt_7 = ConstructPoint(XCoordinate=Slider(950, range=950..1050), YCoordinate=Slider(50, range=-50..50), ZCoordinate=0)
pt_8 = ConstructPoint(XCoordinate=Slider(1050, range=950..1050), YCoordinate=Slider(50, range=-50..50), ZCoordinate=0)
pt_9 = ConstructPoint(XCoordinate=Slider(950, range=950..1050), YCoordinate=Slider(-50, range=-50..50), ZCoordinate=0)
pt_10 = ConstructPoint(XCoordinate=Slider(50, range=-50..50), YCoordinate=Slider(50, range=-50..50), ZCoordinate=0)
pt_11 = ConstructPoint(XCoordinate=Slider(1000, range=0..1000), YCoordinate=0, ZCoordinate=Slider(0, range=0..100))
pt_12 = ConstructPoint(XCoordinate=Slider(500, range=0..500), YCoordinate=0, ZCoordinate=Slider(500, range=0..500))
pt_13 = ConstructPoint(XCoordinate=Slider(-50, range=-50..50), YCoordinate=Slider(-50, range=-50..50), ZCoordinate=0)
pt_14 = Point([pt, pt_2, pt_3, pt_4, pt_5, pt_9, pt_7, pt_8])
arc = Arc3Pt(PointA=pt_6, PointB=pt_12, PointC=pt_11)  # -> Arc, Plane, Radius
rec_2pt = Rectangle2Pt(Plane=PlaneXY(0, 0, 0), PointA=pt_13, PointB=pt_10, Radius=0)  # -> Rectangle, Length
swp1 = Sweep1(Rail=arc.Arc, Sections=rec_2pt.Rectangle, Miter=1)
number_slider = Slider(2, range=0..10)
number_slider_2 = Slider(2, range=0..10)
cap = CapHoles(Brep=swp1)
number_slider_3 = Slider(4, range=0..30)
meshsbrep = MeshSBrep(Brep=cap, Point=pt_14, UCount=number_slider, VCount=number_slider_2, WCount=number_slider_3)  # -> Mesh, Curve, Surface
meshcbrep = MeshCBrep(Brep=cap, Point=pt_14, UCount=number_slider, VCount=number_slider_2, WCount=number_slider_3)
deconstruct_meshcbrep = DeconstructMesh(Mesh=meshsbrep.Mesh)  # -> ElementVertices, Connectivity, Edges, Surfaces, Points, Nodes, Elements
panel = Panel(deconstruct_meshcbrep.ElementVertices)
debrep = DeconstructBrep()  # -> Faces, Edges, Vertices
deconstruct_meshcbrep_2 = DeconstructMesh(Mesh=meshcbrep)  # -> ElementVertices, Connectivity, Edges, Surfaces, Points, Nodes, Elements
item = ListItem(Index=0, Wrap=True)
deconstruct_node = DeconstructNode(Node=deconstruct_meshcbrep.Nodes)  # -> Point, Elements, StringPos, Surfaces, Deformations, Strains, GlobalStrain, GlobalStress
xy = XYPlane(Origin=Point(0, 0, 0))
vec = VectorXYZ(XComponent="500", YComponent="500", ZComponent="500")  # -> Vector, Length
panel_2 = Panel(deconstruct_meshcbrep_2.ElementVertices)
sph = Sphere(Base=xy, Radius="1")
Z = UnitZ(Factor="-10")
Z_2 = UnitZ(Factor=Slider(0, range=0..100))
move = Move(Geometry=sph, Motion=vec.Vector)  # -> Geometry, Transform
deconstruct_node_2 = DeconstructNode(Node=deconstruct_meshcbrep_2.Nodes)  # -> Point, Elements, StringPos, Surfaces, Deformations, Strains, GlobalStrain, GlobalStress
unibc = UniformBCComponentForFEA(SurfaceNumber=Slider(4, range=0..5), Mesh=meshcbrep)  # -> BCPoints, BCCones, ColoringForBCCones
unibc_2 = UniformBCComponentForFEA(SurfaceNumber=Slider(5, range=0..5), Mesh=meshcbrep)  # -> BCPoints, BCCones, ColoringForBCCones
pt_15 = Point(flatten([deconstruct_meshcbrep.Points, deconstruct_meshcbrep_2.Points]))
uniloads = UniformLoadComponentForFEA(SurfaceNumber=Slider(3, range=0..5), LoadVector=Z, Mesh=meshcbrep)  # -> PointLoads, LoadArrows, ArrowColoring
lng = ListLength(List=flatten(deconstruct_meshcbrep_2.Elements))
lng_2 = ListLength(List=flatten(deconstruct_meshcbrep.Elements))
panel_3 = Panel(deconstruct_node.Surfaces)
duppt = RemoveDuplicatePts(Points=pt_15, Tolerance=0.01)
Z_3 = UnitZ(Factor="0")
predef = PreDef(Points="0,0,0", PrescribedDeformations=Z_2)  # -> PrescribedDeformations, Text, Plane, Colors
panel_4 = Panel(deconstruct_node_2.Surfaces)
material = CreateMaterial(EModulus="210000", PRatio="0.3")
predef_2 = PreDef(Sphere=move.Geometry, PrescribedDeformations=Z_3, Mesh=meshcbrep)  # -> PrescribedDeformations, Text, Plane, Colors
panel_5 = Panel(deconstruct_meshcbrep.Points)
panel_6 = Panel(deconstruct_meshcbrep_2.Points)
panel_7 = Panel(duppt)
femeshtbrep = FiniteElementOfMeshedTBrep(
    Mesh=meshcbrep,
    BoundaryConditions=[unibc_2.BCPoints, unibc.BCPoints],
    PointLoads=uniloads.PointLoads,
    PreDeformations=predef_2.PrescribedDeformations,
    Brep=cap,
    Material=material)  # -> Disp, Strain, Stress, N, Text, Size, Plane, Color_T, Nodes
item_2 = ListItem(List=femeshtbrep.N, Index=Slider(160, range=0..1000), Wrap=True)
flatten = FlattenTree(Tree=femeshtbrep.Disp, Path="{0}")
panel_8 = Panel(femeshtbrep.Disp)
panel_9 = Panel(item_2)
sort = SortList(Keys=flatten)  # -> Keys, ValuesA
panel_10 = Panel(sort.Keys)
