# Grasshopper definition CantileverTest.gh (Grasshopper 1.0.7)
# plug-ins: SolidsVR

number_slider = Slider(4, range=0..5)
number_slider_2 = Slider(5, range=0..5)
pt = ConstructPoint(XCoordinate=0, YCoordinate="1000", ZCoordinate="1000")
pt_2 = ConstructPoint(XCoordinate=0, YCoordinate=0, ZCoordinate=0)
pt_3 = ConstructPoint(XCoordinate=0, YCoordinate="1000", ZCoordinate=0)
pt_4 = ConstructPoint(XCoordinate=0, YCoordinate=0, ZCoordinate="1000")
pt_5 = ConstructPoint(XCoordinate="1000", YCoordinate=0, ZCoordinate=0)
pt_6 = ConstructPoint(XCoordinate="1000", YCoordinate="1000", ZCoordinate=0)
pt_7 = ConstructPoint(XCoordinate="1000", YCoordinate="1000", ZCoordinate="1000")
pt_8 = ConstructPoint(XCoordinate="1000", YCoordinate=0, ZCoordinate="1000")
Z = UnitZ(Factor="-500")
pt_9 = Point([pt_2, pt_5, pt_6, pt_3, pt_4, pt_8, pt_7, pt])
number_slider_3 = Slider(3, range=0..20)
vec = VectorXYZ(XComponent="3000", YComponent="3000", ZComponent=0)  # -> Vector, Length
p2b = PointsToBrep(Points=pt_9)
debrep = DeconstructBrep(Brep=p2b)  # -> Faces, Edges, Vertices
item = ListItem(List=debrep.Faces, Index=number_slider, Wrap=True)
item_2 = ListItem(List=debrep.Faces, Index=number_slider_2, Wrap=True)
sph = Sphere(Base=vec.Vector, Radius="1")
meshcbrep = MeshCBrep(
    Brep=p2b,
    Point=pt_9,
    UCount=Slider(3, range=0..20),
    VCount=number_slider_3,
    WCount=number_slider_3,
    RunTopOpt=Toggle(False))
uniloads = UniformLoadComponentForFEA(SurfaceNumber=number_slider_2, LoadVector=Z, Mesh=meshcbrep)  # -> PointLoads, LoadArrows, ArrowColoring
unibc = UniformBCComponentForFEA(Surface=number_slider, UCount=meshcbrep)  # -> BCPoints, BCCones, ColoringForBCCones
predef = PreDef(Sphere=sph, PrescribedDeformations=vec.Vector, Mesh=meshcbrep)  # -> PrescribedDeformations, Text, Plane, Colors
deconstruct_meshcbrep = DeconstructMesh(Mesh=meshcbrep)  # -> ElementVertices, Connectivity, Edges, Surfaces, Points, Nodes, Elements
material = CreateMaterial(EModulus="210000", PRatio="0.3", YieldStress="355")
number_slider_4 = Slider(4, range=0..50)
item_3 = ListItem(List=deconstruct_meshcbrep.Points, Index=number_slider_4, Wrap=True)
topopt = TopOpt(
    Mesh=meshcbrep,
    BoundaryConditions=unibc.BCPoints,
    PointLoads=uniloads.PointLoads,
    PreDeformations=predef.PrescribedDeformations,
    Brep=p2b,
    Material=material)  # -> Disp, Strain, Stress, N, Text, Size, Plane, Color_T, Nodes
viewdef = ViewDeformations(Mesh=meshcbrep, Displacement=topopt.Disp, Scaling=Slider(18, range=0..1000))  # -> BrepSolid, ColorSolid, BrepOuterEdges, ColorEdges, Text, Size, Plane, ColorT
panel = Panel(topopt.Disp)
branch = TreeBranch(Tree=simplify(deconstruct_meshcbrep.Edges), Path=number_slider_4, MaintainPaths=True)
