# Grasshopper definition crossSecByLine_GH.gh (Grasshopper 1.0.7)
# plug-ins: SolidsVR

crv = Curve(<curve referenced from the Rhino model>)
srf = Surface(<surface referenced from the Rhino model>)
frames = CurveFrames(Curve=crv, Count="1")  # -> Frames, Parameters
end = EndPoints(Curve=crv)  # -> Start, End
area = Area(Geometry=srf)  # -> Area, Centroid
item = ListItem(List=frames.Frames, Index=0, Wrap=True)  # -> Item, Item1

subtraction = Subtraction(A=end.End, B=area.Centroid)
move = Move(Geometry=srf, Motion=subtraction)  # -> Geometry, Transform
deplane = DeconstructPlane(Plane=move.Geometry)  # -> Origin, XAxis, YAxis, ZAxis
deplane_2 = DeconstructPlane(Plane=item.Item1)  # -> Origin, XAxis, YAxis, ZAxis
rotate = RotateDirection(Geometry=move.Geometry, Center=end.End, From=deplane.ZAxis, To=deplane_2.ZAxis)  # -> Geometry, Transform
deplane_3 = DeconstructPlane(Plane=rotate.Geometry)  # -> Origin, XAxis, YAxis, ZAxis
rotate_2 = RotateDirection(Geometry=rotate.Geometry, Center=end.End, From=deplane_3.YAxis, To=deplane_2.YAxis)  # -> Geometry, Transform
deplane_4 = DeconstructPlane(Plane=rotate_2.Geometry)  # -> Origin, XAxis, YAxis, ZAxis
rotate_3 = RotateDirection(Geometry=rotate_2.Geometry, Center=end.End, From=deplane_4.XAxis, To=deplane_2.XAxis)  # -> Geometry, Transform
deplane_5 = DeconstructPlane(Plane=rotate_3.Geometry)  # -> Origin, XAxis, YAxis, ZAxis
rot3d = Rotate3D(Geometry=rotate_3.Geometry, Angle="pi/2", Center=end.End, Axis=deplane_5.YAxis)  # -> Geometry, Transform
deplane_6 = DeconstructPlane(Plane=rot3d.Geometry)  # -> Origin, XAxis, YAxis, ZAxis
rot3d_2 = Rotate3D(Geometry=rot3d.Geometry, Angle="-pi/2", Center=end.End, Axis=deplane_6.ZAxis)  # -> Geometry, Transform

subtraction_2 = Subtraction(A=end.Start, B=area.Centroid)
deplane_7 = DeconstructPlane(Plane=item.Item)  # -> Origin, XAxis, YAxis, ZAxis
move_2 = Move(Geometry=srf, Motion=subtraction_2)  # -> Geometry, Transform
deplane_8 = DeconstructPlane(Plane=move_2.Geometry)  # -> Origin, XAxis, YAxis, ZAxis
rotate_4 = RotateDirection(Geometry=move_2.Geometry, Center=end.Start, From=deplane_8.ZAxis, To=deplane_7.ZAxis)  # -> Geometry, Transform
deplane_9 = DeconstructPlane(Plane=rotate_4.Geometry)  # -> Origin, XAxis, YAxis, ZAxis
rotate_5 = RotateDirection(Geometry=rotate_4.Geometry, Center=end.Start, From=deplane_9.YAxis, To=deplane_7.YAxis)  # -> Geometry, Transform
deplane_10 = DeconstructPlane(Plane=rotate_5.Geometry)  # -> Origin, XAxis, YAxis, ZAxis
rotate_6 = RotateDirection(Geometry=rotate_5.Geometry, Center=end.Start, From=deplane_10.XAxis, To=deplane_7.XAxis)  # -> Geometry, Transform
deplane_11 = DeconstructPlane(Plane=rotate_6.Geometry)  # -> Origin, XAxis, YAxis, ZAxis
rot3d_3 = Rotate3D(Geometry=rotate_6.Geometry, Angle="pi/2", Center=end.Start, Axis=deplane_11.YAxis)  # -> Geometry, Transform
deplane_12 = DeconstructPlane(Plane=rot3d_3.Geometry)  # -> Origin, XAxis, YAxis, ZAxis
rot3d_4 = Rotate3D(Geometry=rot3d_3.Geometry, Angle="pi/2", Center=end.Start, Axis=deplane_12.ZAxis)  # -> Geometry, Transform

swp1 = Sweep1(Rail=crv, Sections=[rot3d_4.Geometry, rot3d_2.Geometry], Miter=1)
join = BrepJoin(Breps=flatten([swp1, rot3d_2.Geometry, rot3d_4.Geometry]))  # -> Breps, Closed
debrep = DeconstructBrep(Brep=join.Breps)  # -> Faces, Edges, Vertices
item_2 = ListItem(List=debrep.Vertices, Index=0, Wrap=True)  # -> Item, Item1, Item2, Item3, Item4, Item5, Item6, Item7
pt = Point([item_2.Item5, item_2.Item6, item_2.Item7, item_2.Item4, item_2.Item1, item_2.Item2, item_2.Item3, item_2.Item])
number_slider = Slider(3, range=0..10)
meshsbrep = MeshSBrep(Brep=join.Breps, Point=pt, UCount=number_slider, VCount=number_slider, WCount=Slider(21, range=0..30), VolumeToRemove=0)
deconstruct_meshcbrep = DeconstructMesh(Mesh=meshsbrep)  # -> ElementVertices, Connectivity, Edges, Surfaces, Points, Nodes, Elements
crv_2 = Curve(deconstruct_meshcbrep.Edges)
Z = UnitZ(Factor=Slider(-10, range=-10..10))
# PREDEF
sph = Sphere(Base="9999,9999,9999", Radius=1)
# MATERIAL
panel = Panel("210000")
unibc = UniformBCComponentForFEA(SurfaceNumber=Slider(4, range=0..5), Mesh=meshsbrep)  # -> BCPoints, BCCones, ColoringForBCCones
# LOAD
uniloads = UniformLoadComponentForFEA(SurfaceNumber=Slider(3, range=0..5), LoadVector=Z, Mesh=meshsbrep)  # -> PointLoads, LoadArrows, ArrowColoring
unibc_2 = UniformBCComponentForFEA(SurfaceNumber=Slider(5, range=0..5), Mesh=meshsbrep)  # -> BCPoints, BCCones, ColoringForBCCones
predef = PreDef(Sphere=sph, PrescribedDeformations="0,0,0", Mesh=meshsbrep)  # -> PrescribedDeformations, Text, Plane, Colors, Colors_2
material = CreateMaterial(EModulus=panel, PRatio="0.3", YieldStress="355")
# CALCULATION
topopt = TopOpt(
    Mesh=meshsbrep,
    BoundaryConditions=[unibc.BCPoints, unibc_2.BCPoints],
    PointLoads=uniloads.PointLoads,
    PreDeformations=predef.PrescribedDeformations,
    Material=material)  # -> Displacement, Strain, Stress, Text, Size, Plane, ColorT
# VIEW STRESSES
number_slider_2 = Slider(6, range=0..6)
number_slider_3 = Slider(0, range=0..1000)
# VIEW DEFORMATIONS
viewdef = ViewDeformations(Mesh=meshsbrep, Displacement=topopt.Displacement, Scaling=number_slider_3)  # -> BrepSolid, ColorSolid, BrepOuterEdges, ColorEdges, Text, Size, Plane, ColorT
viewstress = ViewStresses(Mesh=meshsbrep, Stress=topopt.Stress, StressDirection=number_slider_2, Scaling=number_slider_3)  # -> Solid, Color_solid, Legend, Color_legend, Text, Size, Plane, Color_T
