# Grasshopper definition CurveBrep.gh (Grasshopper 1.0.7)
# plug-ins: SolidsVR

number_slider = Slider(10, range=0..10)
number_slider_2 = Slider(10, range=0..10)
number_slider_3 = Slider(10, range=0..10)
number_slider_4 = Slider(5, range=0..10)
number_slider_5 = Slider(38, range=0..110)
number_slider_6 = Slider(33, range=0..110)
number_slider_7 = Slider(10, range=0..10)
pt = ConstructPoint(XCoordinate=number_slider_4, YCoordinate=number_slider_4, ZCoordinate=0)
pt_2 = ConstructPoint(XCoordinate=number_slider_5, YCoordinate=Slider(5, range=0..10), ZCoordinate=number_slider_5)
pt_3 = ConstructPoint(XCoordinate=Slider(71, range=0..110), YCoordinate=Slider(5, range=0..10), ZCoordinate=Slider(38, range=0..110))
pt_4 = ConstructPoint(XCoordinate=Slider(105, range=0..110), YCoordinate=Slider(5, range=0..10), ZCoordinate=0)
pt_5 = ConstructPoint(XCoordinate=Slider(100, range=0..110), YCoordinate=Slider(10, range=0..10), ZCoordinate=0)
pt_6 = ConstructPoint(XCoordinate=Slider(110, range=0..110), YCoordinate=Slider(10, range=0..10), ZCoordinate=0)
pt_7 = ConstructPoint(XCoordinate=Slider(100, range=0..110), YCoordinate=0, ZCoordinate=0)
pt_8 = ConstructPoint(XCoordinate=0, YCoordinate=Slider(10, range=0..10), ZCoordinate=0)
pt_9 = ConstructPoint(XCoordinate=number_slider_7, YCoordinate=number_slider_7, ZCoordinate=0)
pt_10 = ConstructPoint(XCoordinate=0, YCoordinate=0, ZCoordinate=0)
pt_11 = ConstructPoint(XCoordinate=Slider(10, range=0..10), YCoordinate=0, ZCoordinate=0)
pt_12 = ConstructPoint(XCoordinate=Slider(110, range=0..110), YCoordinate=0, ZCoordinate=0)
pline = PolyLine(Vertices=[pt_6, pt_5, pt_7, pt_12], Closed=Toggle(True))
nurbs = NurbsCurve(Vertices=[pt, pt_2, pt_3, pt_4], Degree=3, Periodic=False)  # -> Curve, Length, Domain
number_slider_8 = Slider(2, range=0..10)
pline_2 = PolyLine(Vertices=[pt_8, pt_9, pt_11, pt_10], Closed=Toggle(True))
swp1 = Sweep1(Rail=nurbs.Curve, Sections=[pline_2, pline], Miter=1)
pt_13 = Point([pt_10, pt_11, pt_9, pt_8, pt_12, pt_7, pt_5, pt_6])
cap = CapHoles(Brep=swp1)
debrep = DeconstructBrep(Brep=cap)  # -> Faces, Edges, Vertices
item = ListItem(List=debrep.Faces, Index=Slider(2, range=0..5), Wrap=True)
material = CreateMaterial(EModulus="210000", PRatio="0.3")
Z = UnitZ(Factor="-10")
Z_2 = UnitZ(Factor=Slider(0, range=0..100))
meshcbrep = MeshCBrep(Brep=cap, Point=pt_13, UCount=number_slider_8, VCount=number_slider_8, WCount=Slider(7, range=0..10))
unibc = UniformBCComponentForFEA(SurfaceNumber=Slider(4, range=0..5), Mesh=meshcbrep)  # -> BCPoints, BCCones, ColoringForBCCones
unibc_2 = UniformBCComponentForFEA(SurfaceNumber=Slider(5, range=0..5), Mesh=meshcbrep)  # -> BCPoints, BCCones, ColoringForBCCones
uniloads = UniformLoadComponentForFEA(SurfaceNumber=Slider(3, range=0..5), LoadVector=Z, Mesh=meshcbrep)  # -> PointLoads, LoadArrows, ArrowColoring
predef = PreDef(Points="0,0,0", PrescribedDeformations=Z_2)
femeshtbrep = FiniteElementOfMeshedTBrep(
    Mesh=meshcbrep,
    BoundaryConditions=[unibc.BCPoints, unibc_2.BCPoints],
    PointLoads=uniloads.PointLoads,
    PreDeformations=predef,
    Brep=cap,
    Material=material)  # -> Displacement, Strain, Stress, Nodes, Text, Size, Plane, ColorT
number_slider_9 = Slider(0, range=0..1000)
deconstruct_meshcbrep = DeconstructMesh(Mesh=meshcbrep)  # -> ElementVertices, Connectivity, Edges, Surfaces, Nodes, Nodes_2
item_2 = ListItem(List=deconstruct_meshcbrep.Surfaces, Index=Slider(0, range=0..10), Wrap=True)
viewdef = ViewDeformations(Mesh=meshcbrep, Displacement=femeshtbrep.Displacement, Scaling=number_slider_9)  # -> BrepSolid, ColorSolid, BrepOuterEdges, ColorEdges, Text, Size, Plane, ColorT
srf = Surface(item_2)
viewstress = ViewStresses(
    Mesh=meshcbrep,
    Stresses=femeshtbrep.Stress,
    StressDirection=Slider(6, range=0..6),
    Displacement=femeshtbrep.Displacement,
    Scaling=number_slider_9)  # -> Solid, Color_solid, Legend, Color_legend, Text, Size, Plane, Color_T
panel = Panel(femeshtbrep.Displacement)
panel_2 = Panel(deconstruct_meshcbrep.Surfaces)
crv = Curve()
branch = TreeBranch(Tree=simplify(deconstruct_meshcbrep.Surfaces), Path="0", MaintainPaths=True)
panel_3 = Panel(branch)
