# Grasshopper definition Sensor_case2.gh (Grasshopper 1.0.7)
# plug-ins: SolidsVR

# ----
# DRAWN CS
crv = Curve(<curve referenced from the Rhino model>)
crv_2 = Curve(<curve referenced from the Rhino model>)
crv_3 = Curve(<curve referenced from the Rhino model>)
crv_4 = Curve(<curve referenced from the Rhino model>)
edgesrf = EdgeSurface(CurveA=crv, CurveB=crv_4, CurveC=crv_2, CurveD=crv_3)
area = Area(Geometry=edgesrf)  # -> Area, Centroid

# ----
# RAIL
crv_5 = Curve(<curve referenced from the Rhino model>)
end = EndPoints(Curve=crv_5)  # -> Start, End

# ----
# SECTION 2
endpoint_curve = Point(end.End)
subtraction = Subtraction(A=endpoint_curve, B=area.Centroid)
move = Move(Geometry=edgesrf, Motion=subtraction)  # -> Geometry, Transform
rot3d = Rotate3D(Geometry=move.Geometry, Angle="3*pi/2", Center=endpoint_curve, Axis=Vector(0, 0, 1))  # -> Geometry, Transform
Y = UnitY(Factor=1)
rot3d_2 = Rotate3D(Geometry=rot3d.Geometry, Angle="pi/2", Center=endpoint_curve, Axis=Y)  # -> Geometry, Transform
Z = UnitZ(Factor=1)
rot3d_3 = Rotate3D(Geometry=rot3d_2.Geometry, Angle="pi", Center=endpoint_curve, Axis=Z)  # -> Geometry, Transform
Z_2 = UnitZ(Factor=1)
rot3d_4 = Rotate3D(Geometry=rot3d_3.Geometry, Angle="pi", Center=endpoint_curve, Axis=Z_2)  # -> Geometry, Transform
debrep = DeconstructBrep(Brep=rot3d_4.Geometry)  # -> Faces, Edges, Vertices

# ----
# SECTION 1
startpoint_curve = Point(end.Start)
subtraction_2 = Subtraction(A=startpoint_curve, B=area.Centroid)
move_2 = Move(Geometry=edgesrf, Motion=subtraction_2)  # -> Geometry, Transform
rot3d_5 = Rotate3D(Geometry=move_2.Geometry, Angle=1.570796327, Center=startpoint_curve, Axis=Vector(0, 0, 1))  # -> Geometry, Transform
Y_2 = UnitY(Factor=1)
rot3d_6 = Rotate3D(Geometry=rot3d_5.Geometry, Angle="pi/2", Center=startpoint_curve, Axis=Y_2)  # -> Geometry, Transform
Z_3 = UnitZ(Factor=1)
rot3d_7 = Rotate3D(Geometry=rot3d_6.Geometry, Angle="pi", Center=startpoint_curve, Axis=Z_3)  # -> Geometry, Transform
debrep_2 = DeconstructBrep(Brep=rot3d_7.Geometry)  # -> Faces, Edges, Vertices

# ----
# GEOMETRY
crv_6 = Curve(crv_5)
swp1 = Sweep1(Rail=crv_6, Sections=[rot3d_7.Geometry, rot3d_4.Geometry], Miter=1)
join = BrepJoin(Breps=flatten([swp1, rot3d_7.Geometry, rot3d_4.Geometry]))  # -> Breps, Closed

# ----
# CONTROL POINTS
pt = Point(flatten([debrep_2.Vertices, debrep.Vertices]))
item = ListItem(List=flatten(pt), Index=0, Wrap=True)  # -> Item, Item1, Item2, Item3, Item4, Item5, Item6, Item7
pt_2 = Point([item.Item3, item.Item2, item.Item1, item.Item, item.Item7, item.Item6, item.Item5, item.Item4])

# ----
# CROSS-SECTION DISPLAY
crv_7 = Curve([crv, crv_4, crv_2, crv_3])
crv_8 = Curve(<curve referenced from the Rhino model>)
crv_9 = Curve([<curve referenced from the Rhino model> x3])
# MESHING
# MESH
divslider = DivisionSlider(SliderVR=crv_9, Brep=join.Breps)  # -> UCount, VCount, WCount, Text, Size, Plane, Colors, Geometry
volumeslider = VolumePercentageSlider(SliderVR=crv_8, Brep=join.Breps)  # -> VolumePercentage, Text, Size, Plane, Color, Geometry
meshsbrep = MeshSBrep(
    Brep=join.Breps,
    Point=pt_2,
    UCount=divslider.UCount,
    VCount=divslider.VCount,
    WCount=divslider.WCount,
    VolumeToRemove=volumeslider.VolumePercentage)
crosssec = GetInformationOfCrossSec(Curves=crv_7, Mesh=meshsbrep)  # -> Point, Colors, Text, Size, Plane, Colors_2
tag = TextTag3D(Location=crosssec.Plane, Text=crosssec.Text, Size=crosssec.Size, Colour=crosssec.Colors_2, Justification=7)
deconstruct_meshcbrep = DeconstructMesh(Mesh=meshsbrep)  # -> ElementVertices, Connectivity, Edges, Surfaces, Points, Nodes, Elements
crv_10 = Curve(<curve referenced from the Rhino model>)
crv_11 = Curve(<curve referenced from the Rhino model>)
# LOADS
crv_12 = Curve(<curve referenced from the Rhino model>)
# BOUNDARY CONDITIONS
crv_13 = Curve(<curve referenced from the Rhino model>)
loadslider = LoadSlider(SliderVR=crv_11, Brep=join.Breps)  # -> Load, Text, Size, Plane, Colors, Geometry
surfslider = SurfaceSlider(SliderVR=crv_10, Brep=join.Breps)  # -> SurfaceNumber, Text, Size, Plane, Colors, Geometry
surfslider_2 = SurfaceSlider(SliderVR=crv_13, Brep=join.Breps)  # -> SurfaceNumber, Text, Size, Plane, Colors, Geometry
surfslider_3 = SurfaceSlider(SliderVR=crv_12, Brep=join.Breps)  # -> SurfaceNumber, Text, Size, Plane, Colors, Geometry
uniloads = UniformLoadComponentForFEA(SurfaceNumber=surfslider.SurfaceNumber, LoadVector=loadslider.Load, Mesh=meshsbrep)  # -> PointLoads, LoadArrows, ArrowColoring
crv_14 = Curve(<curve referenced from the Rhino model>)
unibc = UniformBCComponentForFEA(SurfaceNumber=surfslider_2.SurfaceNumber, Mesh=meshsbrep)  # -> BCPoints, BCCones, ColoringForBCCones
unibc_2 = UniformBCComponentForFEA(SurfaceNumber=surfslider_3.SurfaceNumber, Mesh=meshsbrep)  # -> BCPoints, BCCones, ColoringForBCCones
predefslider = PreDefSlider(SliderVR=crv_14, Brep=join.Breps)  # -> PrescribedDeformation, Text, Size, Plane, Colors, Geometry
# PREDEF
brep = Brep(<brep referenced from the Rhino model>)
# MATERIAL
panel = Panel("210000")
predef = PreDef(Sphere=brep, PrescribedDeformations=predefslider.PrescribedDeformation, Mesh=meshsbrep)  # -> PrescribedDeformations, Text, Plane, Colors
material = CreateMaterial(EModulus=panel, PRatio="0.3", YieldStress="255")
# ANALYZE
topopt = TopOpt(
    Mesh=meshsbrep,
    BoundaryConditions=[unibc.BCPoints, unibc_2.BCPoints],
    PointLoads=uniloads.PointLoads,
    PreDeformations=predef.PrescribedDeformations,
    Material=material)  # -> Displacement, Strain, Stress, Nodes, Text, Size, Plane
crv_15 = Curve(<curve referenced from the Rhino model>)
item_2 = ListItem(List=topopt.Stress, Index=Slider(6, range=0..6), Wrap=True)
crv_16 = Curve([<curve referenced from the Rhino model> x3])
brep_2 = Brep(<brep referenced from the Rhino model>)
panel_2 = Panel(item_2)
defslider = DeformationSlider(SliderVR=crv_15, Brep=join.Breps)  # -> Scale, Text, Size, Plane, Colors, Geometry
headlines = CreateHeadlines(Curves=crv_16, Mesh=meshsbrep)  # -> Text, Size, Plane, Colors
crv_17 = Curve(<curve referenced from the Rhino model>)
node_info = GetInformationOfNode(Sphere=brep_2, Mesh=meshsbrep)  # -> Text, Size, Plane, Colors, TextSphere, Size_2, PlaneSphere
# VIEW STRESSES
stressslider = StressDirectionSlider(SliderVR=crv_17, Brep=join.Breps)  # -> StressDirection, Text, Size, Plane, Color, Geometry
tag_2 = TextTag3D(Location=headlines.Plane, Text=headlines.Text, Size=headlines.Size, Colour=headlines.Colors, Justification=7)
# VIEW DEFORMATIONS
viewdef = ViewDeformations(Mesh=meshsbrep, Displacement=topopt.Displacement, Scaling=defslider.Scale)  # -> BrepSolid, ColorSolid, BrepOuterEdges, ColorEdges, Text, Size, Plane, ColorT
viewstress = ViewStresses(Mesh=meshsbrep, Stress=topopt.Stress, StressDirection=stressslider.StressDirection, Scaling=defslider.Scale)  # -> Solid, Color_solid, Legend, Color_legend, Text, Size, Plane, Color_T
sort = SortList(Keys=flatten(item_2))  # -> Keys, ValuesA
panel_3 = Panel(sort.Keys)
