# Grasshopper definition VR_geometry_case4.gh (Grasshopper 1.0.7)
# plug-ins: SolidsVR

point2 = Point(<point referenced from the Rhino model>)
point3 = Point(<point referenced from the Rhino model>)
# Cross Section 1
point1 = Point(<point referenced from the Rhino model>)
point4 = Point(<point referenced from the Rhino model>)
point2_2 = Point(<point referenced from the Rhino model>)
point3_2 = Point(<point referenced from the Rhino model>)
point1_2 = Point(<point referenced from the Rhino model>)
point4_2 = Point(<point referenced from the Rhino model>)
# POINTS FOR FIXING ORDER
pt = Point([point1, point2, point3, point4, point1_2, point2_2, point3_2, point4_2])

# ---- group: Curve1
control1 = Point(<point referenced from the Rhino model>)
control2 = Point(<point referenced from the Rhino model>)
pt_2 = Point([point1, control1, control2, point2])
nurbs = NurbsCurve(Vertices=pt_2, Degree=3, Periodic=False)  # -> Curve, Length, Domain

# ---- group: Curve1 / Curve3
control1_2 = Point(<point referenced from the Rhino model>)
control2_2 = Point(<point referenced from the Rhino model>)
pt_3 = Point([point3, control1_2, control2_2, point4])
nurbs_2 = NurbsCurve(Vertices=pt_3, Degree=3, Periodic=False)  # -> Curve, Length, Domain

# ---- group: Curve1 / Curve2
control1_3 = Point(<point referenced from the Rhino model>)
control2_3 = Point(<point referenced from the Rhino model>)
pt_4 = Point([point2, control1_3, control2_3, point3])
nurbs_3 = NurbsCurve(Vertices=pt_4, Degree=3, Periodic=False)  # -> Curve, Length, Domain

# ---- group: Curve1 / Curve4
control1_4 = Point(<point referenced from the Rhino model>)
control2_4 = Point(<point referenced from the Rhino model>)
pt_5 = Point([point4, control1_4, control2_4, point1])
nurbs_4 = NurbsCurve(Vertices=pt_5, Degree=3, Periodic=False)  # -> Curve, Length, Domain

# ---- group: Curve1
# Cross Section 2
control1_5 = Point(<point referenced from the Rhino model>)
control2_5 = Point(<point referenced from the Rhino model>)
pt_6 = Point([point1_2, control1_5, control2_5, point2_2])
nurbs_5 = NurbsCurve(Vertices=pt_6, Degree=3, Periodic=False)  # -> Curve, Length, Domain

# ---- group: Curve1 / Curve3
control1_6 = Point(<point referenced from the Rhino model>)
control2_6 = Point(<point referenced from the Rhino model>)
pt_7 = Point([point3_2, control1_6, control2_6, point4_2])
nurbs_6 = NurbsCurve(Vertices=pt_7, Degree=3, Periodic=False)  # -> Curve, Length, Domain

# ---- group: Curve1 / Curve2
control1_7 = Point(<point referenced from the Rhino model>)
control2_7 = Point(<point referenced from the Rhino model>)
pt_8 = Point([point2_2, control1_7, control2_7, point3_2])
nurbs_7 = NurbsCurve(Vertices=pt_8, Degree=3, Periodic=False)  # -> Curve, Length, Domain

# ---- group: Curve1 / Curve4
control1_8 = Point(<point referenced from the Rhino model>)
control2_8 = Point(<point referenced from the Rhino model>)
pt_9 = Point([point4_2, control1_8, control2_8, point1_2])
nurbs_8 = NurbsCurve(Vertices=pt_9, Degree=3, Periodic=False)  # -> Curve, Length, Domain

# ----
# RAIL
crv = Curve(<curve referenced from the Rhino model>)
crv_2 = Curve(<curve referenced from the Rhino model>)
crv_3 = Curve(<curve referenced from the Rhino model>)
crv_4 = Curve(<curve referenced from the Rhino model>)
crv_5 = Curve(<curve referenced from the Rhino model>)
crv_6 = Curve(<curve referenced from the Rhino model>)
crv_7 = Curve(<curve referenced from the Rhino model>)
crv_8 = Curve(<curve referenced from the Rhino model>)
crv_9 = Curve(<curve referenced from the Rhino model>)
edgesrf = EdgeSurface(CurveA=crv_2, CurveB=crv_3, CurveC=crv_4, CurveD=crv_5)
edgesrf_2 = EdgeSurface(CurveA=crv_7, CurveB=crv_6, CurveC=crv_8, CurveD=crv_9)
area = Area(Geometry=edgesrf_2)  # -> Area, Centroid
area_2 = Area(Geometry=edgesrf)  # -> Area, Centroid
swp1 = Sweep1(Rail=crv, Sections=[edgesrf, edgesrf_2], Miter=1)
curve = Curve([<curve referenced from the Rhino model> x3])
join = BrepJoin(Breps=flatten([swp1, edgesrf, edgesrf_2]))  # -> Breps, Closed
cap = CapHoles(Brep=swp1)
divisionslider = DivisionSlider(SliderVR=curve, Brep=join.Breps)  # -> UCount, VCount, WCount, Text, Size, Plane, Colors, Geometry
curve_2 = Curve(<curve referenced from the Rhino model>)
volumepercentageslider = VolumePercentageSlider(SliderVR=curve_2, Brep=join.Breps)  # -> VolumePercentage, Text, Size, Plane, Color, Geometry
meshsbrep = MeshSBrep(
    Brep=join.Breps,
    Point=pt,
    UCount=divisionslider.UCount,
    VCount=divisionslider.VCount,
    WCount=divisionslider.WCount,
    VolumeToRemove=volumepercentageslider.VolumePercentage)
deconstruct_meshcbrep = DeconstructMesh(Mesh=meshsbrep)  # -> ElementVertices, Connectivity, Edges, Surfaces, Points, Nodes, Elements
# MESH
meshsbrep_2 = MeshSBrep(
    Brep=join.Breps,
    Point=pt,
    UCount=divisionslider.UCount,
    VCount=divisionslider.VCount,
    WCount=divisionslider.WCount,
    VolumeToRemove=0)
crv_10 = Curve(<curve referenced from the Rhino model>)
crv_11 = Curve(<curve referenced from the Rhino model>)
crv_12 = Curve(<curve referenced from the Rhino model>)
curve_3 = Curve(<curve referenced from the Rhino model>)
crv_13 = Curve(<curve referenced from the Rhino model>)
surfslider = SurfaceSlider(SliderVR=crv_10, Brep=join.Breps)  # -> SurfaceNumber, Text, Size, Plane, Colors, Geometry
surfslider_2 = SurfaceSlider(SliderVR=crv_12, Brep=join.Breps)  # -> SurfaceNumber, Text, Size, Plane, Colors, Geometry
loadslider = LoadSlider(SliderVR=crv_11, Brep=join.Breps)  # -> Load, Text, Size, Plane, Colors, Geometry
predefslider = PreDefSlider(SliderVR=crv_13, Brep=join.Breps)  # -> PrescribedDeformation, Text, Size, Plane, Colors, Geometry
surfslider_3 = SurfaceSlider(SliderVR=curve_3, Brep=join.Breps)  # -> SurfaceNumber, Text, Size, Plane, Colors, Geometry
panel = Panel(surfslider.SurfaceNumber)
brep = Brep(<brep referenced from the Rhino model>)
brep_2 = Brep(<brep referenced from the Rhino model>)
get_information_of_node = GetInformationOfNode(Sphere=brep, Mesh=meshsbrep)  # -> Text, Size, Plane, Colors, TextSphere, Size_2, PlaneSphere
predef = PreDef(Sphere=brep_2, PrescribedDeformations=predefslider.PrescribedDeformation, Mesh=meshsbrep)  # -> PrescribedDeformations, Text, Plane, Colors
unibc = UniformBCComponentForFEA(SurfaceNumber=surfslider.SurfaceNumber, Mesh=meshsbrep)  # -> BCPoints, BCCones, ColoringForBCCones
unibc_2 = UniformBCComponentForFEA(SurfaceNumber=surfslider_2.SurfaceNumber, Mesh=meshsbrep)  # -> BCPoints, BCCones, ColoringForBCCones
uniloads = UniformLoadComponentForFEA(SurfaceNumber=surfslider_3.SurfaceNumber, LoadVector=loadslider.Load, Mesh=meshsbrep)  # -> PointLoads, LoadArrows, ArrowColoring
material = CreateMaterial(EModulus="210000", PRatio="0.3", YieldStress="255")
geo = Geometry(unibc_2.BCCones)
topopt = TopOpt(
    Mesh=meshsbrep,
    BoundaryConditions=[unibc.BCPoints, unibc_2.BCPoints],
    PointLoads=uniloads.PointLoads,
    PreDeformations=predef.PrescribedDeformations,
    Material=material)  # -> Displacement, Strain, Stress, Nodes, Text, Size, Plane
crv_14 = Curve(<curve referenced from the Rhino model>)
stressslider = StressDirectionSlider(SliderVR=crv_14, Brep=join.Breps)  # -> StressDirection, Text, Size, Plane, Color, Geometry
crv_15 = Curve(<curve referenced from the Rhino model>)
defslider = DeformationSlider(SliderVR=crv_15, Brep=join.Breps)  # -> Scale, Text, Size, Plane, Colors, Geometry
viewdeformations = ViewDeformations(Mesh=meshsbrep, Displacement=topopt.Displacement, Scaling=defslider.Scale)  # -> BrepSolid, ColorSolid, BrepOuterEdges, ColorEdges, Text, Size, Plane, Colors
viewstresses = ViewStresses(Mesh=meshsbrep, Stress=topopt.Stress, StressDirection=stressslider.StressDirection, Scaling=defslider.Scale)  # -> BrepSolid, Colors, StressLegend, Colors_2, Text, Size, Plane, Colors_3
