# Grasshopper definition compare.gh (Grasshopper 1.0.7)
# plug-ins: SolidsVR

pt = ConstructPoint(XCoordinate=0, YCoordinate="10", ZCoordinate="10")
pt_2 = ConstructPoint(XCoordinate=0, YCoordinate=0, ZCoordinate=0)
pt_3 = ConstructPoint(XCoordinate=0, YCoordinate="10", ZCoordinate=0)
pt_4 = ConstructPoint(XCoordinate=0, YCoordinate=0, ZCoordinate="10")
pt_5 = ConstructPoint(XCoordinate="50", YCoordinate=0, ZCoordinate=0)
pt_6 = ConstructPoint(XCoordinate="50", YCoordinate="10", ZCoordinate=0)
pt_7 = ConstructPoint(XCoordinate="50", YCoordinate="10", ZCoordinate="10")
pt_8 = ConstructPoint(XCoordinate="50", YCoordinate=0, ZCoordinate="10")
number_slider = Slider(0, range=0..100)
Z = UnitZ(Factor="-10")
number_slider_2 = Slider(10, range=0..10)
number_slider_3 = Slider(2, range=0..10)
pt_9 = Point([pt_2, pt_3, pt, pt_4, pt_5, pt_6, pt_7, pt_8])
vec = VectorXYZ(XComponent=number_slider, YComponent=number_slider, ZComponent=number_slider)  # -> Vector, Length
p2b = PointsToBrep(Points=pt_9)
debrep = DeconstructBrep(Brep=p2b)  # -> Faces, Edges, Vertices
item = ListItem(List=debrep.Faces, Index=Slider(4, range=0..5), Wrap=True)
item_2 = ListItem(List=debrep.Faces, Index=Slider(2, range=0..5), Wrap=True)
unibc = UniformBCComponentForFEA(Surface=item, UCount=number_slider_3, VCount=number_slider_3, WCount=number_slider_2, Brep=p2b)  # -> BCPoints, BCCones, ColoringForBCCones
predef = PreDef(Points="0,0,0", PrescribedDeformations=vec.Vector)
uniloads = UniformLoadComponentForFEA(Surface=item_2, LoadVector=Z, UCount=number_slider_3, VCount=number_slider_3, WCount=number_slider_2, Brep=p2b)  # -> PointLoads, LoadArrows, ArrowColoring
meshcbrep = MeshCBrep(Brep=p2b, Point=pt_9, UCount=number_slider_3, VCount=number_slider_3, WCount=number_slider_2)
material = CreateMaterial(EModulus="210000", PRatio="0.3")
femeshtbrep = FiniteElementOfMeshedTBrep(
    Mesh=meshcbrep,
    BoundaryConditions=unibc.BCPoints,
    PointLoads=uniloads.PointLoads,
    PreDeformations=predef,
    Brep=p2b,
    Material=material)  # -> Displacement, Strain, Stress, Nodes, Text, Size, Plane, ColorT
viewdef = ViewDeformations(Mesh=meshcbrep, Displacement=femeshtbrep.Displacement, Scaling=Slider(21, range=0..100), Brep=p2b)  # -> BrepSolid, ColorSolid, BrepOuterEdges, ColorEdges, Text, Size, Plane, ColorT
panel = Panel(femeshtbrep.Displacement)
